# Grasshopper definition db_fetcher.gh (Grasshopper 1.0.7)
# plug-ins: ScriptParasite, Chimera

here = Here()  # -> FolderPath, Directory, ScriptPath

r_csv = CSharpScript(csv="C:\Users\Sean\Downloads\database.csv", col_pat="3d_model")  # -> data; inputs csv: String, col_pat: String
# ---------- r_csv: C# usings ----------
using System.IO;
# ---------- r_csv: C# ----------
    List<string> datas = SearchCsvColumn(csv, col_pat);
    data = datas;
# ---------- r_csv: C# additional code ----------
  private List<string> SearchCsvColumn(string filePath, string pattern)
  {
    var matchedValues = new List<string>();

    if (!File.Exists(filePath))
    {
      Component.AddRuntimeMessage(GH_RuntimeMessageLevel.Error, "File not found");
      return null;
    }

    try
    {
      using (var reader = new StreamReader(filePath))
      {
        int lineCount = 0;
        int colIndex = -1;
        while (!reader.EndOfStream)
        {
          var line = reader.ReadLine();
          var values = line.Split(',');
          if (lineCount == 0)
          {
            for (var i = 0; i < values.Length; i++)
            {
              var value = values[i];
              if (value.StartsWith(pattern))
              {
                colIndex = i;
              }
            }
          }
          else
          {
            if (colIndex == -1)
            {
              Component.AddRuntimeMessage(GH_RuntimeMessageLevel.Error, "Column not found");
              return null;
            }
            for (int i = 0; i < values.Length; i++)
            {
              if (i == colIndex)
              {
                var value = values[i];
                matchedValues.Add(value);
              }
            }
          }
          lineCount++;
        }
      }
    }
    catch (Exception e)
    {
      Component.AddRuntimeMessage(GH_RuntimeMessageLevel.Error, e.Message);
      throw;
    }
    

    return matchedValues;
  }
# ---------- end r_csv ----------
scriptpar = ScriptParasite(Enable=Toggle(True), Folder=here.FolderPath)

panel = Panel(r_csv)
here_2 = Here()  # -> FolderPath, Directory, ScriptPath

scriptpar_2 = ScriptParasite(Enable=Toggle(True), Folder=here_2.FolderPath)
fetch = CSharpScript(urls=r_csv, temp_dir="C:\Users\Sean\Downloads\database", fetch=Button())  # -> out, A; inputs urls: list of String, temp_dir: String, fetch: Boolean
# ---------- fetch: C# usings ----------
using System.IO;
using System.Net;
# ---------- fetch: C# ----------
    if (fetch)
    {
      msg = new List<string>();
      try
      {
        WebClient client = new WebClient();
        if (!Directory.Exists(temp_dir))
        {
          Directory.CreateDirectory(temp_dir);
        }

        string filename = urls[0].Split('/')[urls[0].Split('/').Length - 1];
        foreach (var url in urls)
        {
          client.DownloadFile(new Uri(url), temp_dir + "/" + filename);
        }
      }
      catch (Exception e)
      {
        msg.Add(e.Message);
        errorInPreviousRun = true;
      }
    }

    if (errorInPreviousRun)
    {
      Component.AddRuntimeMessage(GH_RuntimeMessageLevel.Error, string.Join("\n", msg));
    }
# ---------- fetch: C# additional code ----------
  List<string> msg;
  private bool errorInPreviousRun = false;
# ---------- end fetch ----------
